# Grasshopper definition C02_visualisation.gh (Grasshopper 1.0.7)
# plug-ins: Kangaroo2 Components

# ----
# Startkoordinater
x = Slider(14136, range=0..100000)
y = Slider(-22496, range=-44000..0)
z = Slider(3018, range=0..100000)

construct_point = ConstructPoint(XCoordinate=0, YCoordinate=0, ZCoordinate="45121.25")
x_bredde_på_rektangel = Slider(125000, range=0..200000)
division = Division(A=x_bredde_på_rektangel, B="2")
addition = Addition(A=x, B=division)
lengde_bygg = Slider(45388, range=0..100000)
cluster = Cluster(A=x_bredde_på_rektangel)
deconstruct_domain = DeconstructDomain(Domain=cluster)  # -> Start, End
addition_2 = Addition(A=deconstruct_domain.End, B=addition, C=Slider(20000, range=0..20000))

# ----
# RIB
høyde = Slider(10000, range=0..10000)
antall_co2_baller = Slider(926, range=0..100000)

# ----
# Diameter CO2
diameter = Slider(10006.8, range=0..20000)

subtraction = Subtraction(A=lengde_bygg, B=diameter)
cluster_2 = Cluster(A=subtraction)

# ----
# RIV
høyde_2 = Slider(7598, range=0..10000)
antall_co2_baller_2 = Slider(56, range=0..100)

# ----
# Radius
panel = Panel("2")
division_2 = Division(A=diameter, B=panel)

addition_3 = Addition(A=division_2, B=z)
construct_point_2 = ConstructPoint(XCoordinate=addition, YCoordinate=y, ZCoordinate=addition_3)
xy_plane = XYPlane(Origin=construct_point_2)
rectangle = Rectangle(Plane=xy_plane, XSize=cluster, YSize=cluster_2, Radius=0)  # -> Rectangle, Length

# ----
# SH
antall_co2_baller_3 = Slider(8, range=0..100)

# ----
# RIE
antall_co2_baller_4 = Slider(136, range=0..200)

addition_4 = Addition(A=antall_co2_baller, B=antall_co2_baller_2, C=antall_co2_baller_4, D=antall_co2_baller_3)
unit_z = UnitZ(Factor="-1")
addition_5 = Addition(A=antall_co2_baller, B=antall_co2_baller_4, C="-1")
addition_6 = Addition(A=addition_5, B=antall_co2_baller_2)
addition_7 = Addition(A=addition_6, B=antall_co2_baller_3)
addition_8 = Addition(A=addition_5, B="1")
addition_9 = Addition(A=addition_6, B="1")
subtraction_2 = Subtraction(A=antall_co2_baller, B="1")
construct_domain = ConstructDomain(DomainStart=antall_co2_baller, DomainEnd=addition_5)
construct_domain_2 = ConstructDomain(DomainStart=addition_9, DomainEnd=addition_7)
construct_domain_3 = ConstructDomain(DomainStart=addition_8, DomainEnd=addition_6)
construct_domain_4 = ConstructDomain(DomainStart=0, DomainEnd=subtraction_2)
unit_x = UnitX(Factor=Slider(20000, range=0..20000))
unit_x_2 = UnitX(Factor=division_2)
colour_picker = ColourPicker(PickedColour=RGB(59, 59, 59))
number_slider = Slider(8048, range=0..10000)
concatenate = Concatenate(Fragment_A="Smartbygg: ", Fragment_B=antall_co2_baller_3, A=" tonn CO2 spart per år")
concatenate_2 = Concatenate(Fragment_A="Konstruksjon: ", Fragment_B=antall_co2_baller, A=" tonn CO2 spart")
concatenate_3 = Concatenate(Fragment_A="VVS: ", Fragment_B=antall_co2_baller_2, A=" tonn CO2 spart")
concatenate_4 = Concatenate(Fragment_A="Elektro: ", Fragment_B=antall_co2_baller_4, A=" tonn CO2 spart")

# ----
# Punktboks
panel_2 = Panel("141422")

addition_10 = Addition(A=panel_2, B=Slider(40000, range=0..40000))

unit_z_2 = UnitZ(Factor=addition_10)
move = Move(Geometry=xy_plane, Motion=unit_z_2)  # -> Geometry, Transform
rectangle_2 = Rectangle(Plane=move.Geometry, XSize=cluster, YSize=cluster_2, Radius=0)  # -> Rectangle, Length
box_rectangle = BoxRectangle(Rectangle=rectangle_2.Rectangle, Height=Slider(200000, range=0..300000))

subtraction_3 = Subtraction(A=panel_2, B=division_2, C=addition_3)
addition_11 = Addition(A=addition_3, B=subtraction_3)
construct_domain_5 = ConstructDomain(DomainStart=addition_3, DomainEnd=addition_11)
range = Range(Domain=construct_domain_5, Steps=Slider(4, range=0..10))
construct_point_3 = ConstructPoint(XCoordinate=addition_2, YCoordinate=y, ZCoordinate=range)
xz_plane = XZPlane(Origin=construct_point_3)  # -> flatten(Plane)
list_item = ListItem(List=xz_plane, Index="4", Wrap=True)
list_item_2 = ListItem(List=xz_plane, Index="3", Wrap=True)
list_item_3 = ListItem(List=xz_plane, Index="2", Wrap=True)
list_item_4 = ListItem(List=xz_plane, Index="1", Wrap=True)
box_rectangle_2 = BoxRectangle(Rectangle=rectangle.Rectangle, Height=subtraction_3)
populate_3d = Populate3D(Region=box_rectangle, Count=addition_4, Seed=1)
populate_geometry = PopulateGeometry(Geometry=box_rectangle, Count=addition_4, Seed=1)  # disabled
load = Load(Point=populate_3d, ForceVector=unit_z, Weighting=1)
spherecollide = SphereCollide(Points=populate_3d, Radius=division_2, Strength=1)
solidpointcollide = SolidPointCollide(Points=populate_3d, Solid=box_rectangle_2, Interior=Toggle(True), Unidirectional=True, Strength=1)
bouncysolver = BouncySolver(
    GoalObjects=[load, spherecollide, solidpointcollide],
    Reset=Button(),
    Threshold=Slider(0.1, range=0..0.1),
    Tolerance=0.0001,
    Damping=0.99,
    Iterations=Slider(1, range=0..100),
    On=Toggle(False))  # -> I, V, O
sort_points = SortPoints(Points=bouncysolver.V)  # -> Points, Indices
sub_list = SubList(List=sort_points.Points, Domain=construct_domain_3, Wrap=True)  # -> List, Index
sub_list_2 = SubList(List=sort_points.Points, Domain=construct_domain_2, Wrap=True)  # -> List, Index
sub_list_3 = SubList(List=sort_points.Points, Domain=construct_domain_4, Wrap=True)  # -> List, Index
sub_list_4 = SubList(List=sort_points.Points, Domain=construct_domain, Wrap=True)  # -> List, Index
list_item_5 = ListItem(List=xz_plane, Index="0", Wrap=True)
point = Point(bouncysolver.V)
move_2 = Move(Geometry=list_item_5, Motion=unit_x_2)  # -> Geometry, Transform
move_3 = Move(Geometry=move_2.Geometry, Motion=unit_x)  # -> Geometry, Transform

# ---- group: RIB
# RIE
mesh_sphere = MeshSphere(Base=sub_list_4.List, Radius=division_2, UCount=10, VCount=20)
colour_picker_2 = ColourPicker(PickedColour=RGB(206, 20, 50))
custom_preview = CustomPreview(Geometry=mesh_sphere, Material=colour_picker_2)

# RIV
mesh_sphere_2 = MeshSphere(Base=sub_list.List, Radius=division_2, UCount=10, VCount=20)
colour_picker_3 = ColourPicker(PickedColour=RGB(0, 167, 109))
custom_preview_2 = CustomPreview(Geometry=mesh_sphere_2, Material=colour_picker_3)

# SH
mesh_sphere_3 = MeshSphere(Base=sub_list_2.List, Radius=division_2, UCount=10, VCount=20)
colour_picker_4 = ColourPicker(PickedColour=RGB(248, 153, 46))
custom_preview_3 = CustomPreview(Geometry=mesh_sphere_3, Material=colour_picker_4)

mesh_sphere_4 = MeshSphere(Base=sub_list_3.List, Radius=division_2, UCount=10, VCount=20)
colour_picker_5 = ColourPicker(PickedColour=RGB(0, 91, 170))
custom_preview_4 = CustomPreview(Geometry=mesh_sphere_4, Material=colour_picker_5)

# ----
mesh_sphere_5 = MeshSphere(Base=move_2.Geometry, Radius=division_2, UCount=10, VCount=20)
custom_preview_5 = CustomPreview(Geometry=mesh_sphere_5, Material=colour_picker)
text_tag_3d = TextTag3D(Location=list_item, Text=concatenate, Size=number_slider, Colour=colour_picker_4, Justification=7)
text_tag_3d_2 = TextTag3D(Location=list_item_2, Text=concatenate_3, Size=number_slider, Colour=colour_picker_3, Justification=7)
text_tag_3d_3 = TextTag3D(Location=list_item_3, Text=concatenate_4, Size=number_slider, Colour=colour_picker_2, Justification=7)
text_tag_3d_4 = TextTag3D(Location=list_item_4, Text=concatenate_2, Size=number_slider, Colour=colour_picker_5, Justification=7)
text_tag_3d_5 = TextTag3D(Location=move_3.Geometry, Text="1 tonn CO2, d=10 m", Size=number_slider, Colour=colour_picker, Justification=7)

# ==== cluster Cluster
A = ClusterInput()

division = Division(A=A, B="-2")
division_2 = Division(A=A, B="2")
construct_domain = ConstructDomain(DomainStart=division, DomainEnd=division_2)

domain = ClusterOutput(construct_domain)
